vi "BPSK_FEC.gvi"   [LabVIEW Communications System Design Suite 2.0.1]
panel controls:
  "IQ rate": f64 = 200000
  "device names": "niUSRPClass"
  "carrier frequency": f64 = 400000000
  "gain Tx": f64
  "active antenna Tx": string = "TX1"
  "stop Tx": bool
  "gain Rx": f64
  "active antenna Rx": string = "RX2"
  "total bits": i32 = 128
  "symbol rate": f64
  "pulse shaping filter": T2 = "Root Raised Cos"
panel indicators:
  "Baseband Waveform": waveform<f64>
  "Baseband Power Spectrum_tx": T1
  "L": f64
  "1/Tx": f64
  "1/T": f64
  "No samples": i32
  "Baseband Power Spectrum_rx": T1
  "M": f64
  "trigger found?": bool
  "BER": f64
  "message length": i32
  "message bits": i8[]
  "output": i16[]
  "size(s)": i32
types:
  T1 = cluster{"f0": f64, "df": f64, "magnitude": f64[]}
  T2 = enum{"none", "Raised Cosine", "Root Raised Cos", "Gaussian"}
uses:
  NI::Analysis::Resampling::Upsample (DBL).gvi
  NI::Analysis::Operations::1D Convolution (DBL).gvi
  NI::Analysis::Resampling::Decimate (single shot, DBL).gvi
diagram:
  call "MT Generate Bits (Fibonacci, PN Order).gvi"(total bits=$"total bits") -> (output bit stream=w1)
  $"message bits" <- w1
  Build Array[ConcatenateInputs=True](w1, w1, w1) -> w2
  for {
    w3 = each element of w2
    Is Greater Than 0(x=w3) -> w5
    Select(s=w5, t=w3, f=-1) -> w6
    append w6 to w4
  }
  call "AddFrameHeader.gvi"(array=w4) -> (output array=w7)
  Divide(x=$"IQ rate", y=$"symbol rate") -> w8
  call "Upsample (DBL).gvi"(input array=w7, upsampling factor=w8) -> (upsampled array=w9)
  call "MT Generate Filter Coefficients.gvi"(pulse shaping filter=$"pulse shaping filter", pulse shaping samples per symbol=w8, modulation type="PSK") -> (pulse shaping filter coefficients=w10)
  call "1D Convolution (DBL).gvi"(x=w9, y=w10) -> (x * y=w11)
  call "Quick Scale 1D.gvi"(X=w11) -> (Y[i]=X[i]/Max|X|=w12)
  Build Waveform Node(Y=w12, dt=$"IQ rate") -> (output waveform=w13)
  $"Baseband Waveform" <- w13
  w14 = cluster{"t0": timestamp, "dt": f64, "Y": c128[]} {all zero or empty}
  Property Node(instance in=w14, "dt"=$"IQ rate", "Y"=w12) -> (instance out=w15)
  call "FFT Power Spectrum for 1 Chan (CDB)2.gvi"(time signal=w15, dB On (F)=TRUE) -> (power spectrum=w16)
  $"Baseband Power Spectrum_tx" <- w16
  $L <- w8
  Array Size(array=w2) -> (size(s)=w17)
  $"message length" <- w17
  $"1/Tx" <- $"IQ rate"
  $"1/T" <- $"symbol rate"
  call "niUSRP Open Rx Session.gvi"(device names=$"device names") -> (error out=w18, session handle out=w19)
  call "niUSRP Configure Signal.gvi"(session handle=w19, IQ rate=$"IQ rate", carrier frequency=$"carrier frequency", gain=$"gain Rx", error in=w18, active antenna=$"active antenna Rx") -> (session handle out=w20, coerced carrier frequency=w21, error out=w22)
  Subtract(x=w21, y=20000) -> w23
  Property Node(instance in=w20, "LO Frequency"=w23) -> (instance out=w24)
  call "niUSRP Initiate.gvi"(session handle=w24, error in=w22) -> (session handle out=w25, error out=w26)
  call "niUSRP Fetch Rx Data (CDB).gvi"(session handle=w25, number of samples=1000000, error in=w26) -> (session handle out=w27, data=w28, error out=w29)
  call "niUSRP Close Session.gvi"(session handle=w27, error in=w29)
  Real And Imaginary To Complex(x=w12, y=0) -> w30
  call "Insert Pilots.gvi"(signal input=w30) -> (output signal=w31)
  call "AddFrameHeader (complex).gvi"(array=w31) -> (output array=w32)
  Array Size(array=w32) -> (size(s)=w33)
  $"No samples" <- w33
  call "niUSRP Open Tx Session.gvi"(device names=$"device names") -> (session handle out=w34, error out=w35)
  call "niUSRP Configure Signal.gvi"(session handle=w34, IQ rate=$"IQ rate", carrier frequency=$"carrier frequency", gain=$"gain Tx", error in=w35, active antenna=$"active antenna Tx") -> (session handle out=w36, error out=w37)
  while {
    call "niUSRP Write Tx Data (CDB).gvi"(session handle=w36, data=w32, error in=w37) -> (session handle out=w38, error out=w39)
    stop if $"stop Tx"
  }
  call "niUSRP Close Session.gvi"(session handle=w38, error in=w39)
  $M <- w8
  call "FrameSync.gvi"(Sampled Input=w28) -> (Aligned Samples=w40)
  call "Channel Estimator.gvi"(input signal=w40) -> (signal out=w41)
  Complex To Real Imaginary(x + iy=w41) -> (x=w42)
  call "MT Generate Filter Coefficients.gvi"(pulse shaping filter="Root Raised Cos", matched samples per symbol=w8, modulation type="PSK") -> (matched filter coefficients=w43)
  call "1D Convolution (DBL).gvi"(x=w43, y=w42) -> (x * y=w44)
  w45 = cluster{"t0": timestamp, "dt": f64, "Y": c128[]} {all zero or empty}
  Property Node(instance in=w45, "dt"=$"IQ rate", "Y"=w44) -> (instance out=w46)
  call "FFT Power Spectrum for 1 Chan (CDB)2.gvi"(time signal=w46, dB On (F)=TRUE) -> (power spectrum=w47)
  $"Baseband Power Spectrum_rx" <- w47
  call "PulseAlign.gvi"(Input signal=w44, Receiver Sampling Factor=w8) -> (aligned output=w48)
  Complex To Real Imaginary(x + iy=w48) -> (x=w49)
  call "Decimate (single shot, DBL).gvi"(input array=w49, decimating factor=w8) -> (decimated array=w50)
  call "FrameSync.gvi"(Sampled Input=w50) -> (Aligned Samples=w51)
  for {
    w52 = each element of w51
    Complex To Real Imaginary(x + iy=w52) -> (x=w54)
    Is Greater Than 0(x=w54) -> w55
    append w55 to w53
  }
  Boolean To Integer(Boolean=w53) -> (0, 1=w56)
  Array Subset(array=w56, index0=0, length0=w17) -> w57
  call "FEC Decoder.gvi"(data_in=w57) -> (output=w58)
  call "MT Calculate BER After Trigger (Fibonacci PN Sequence).gvi"(input bit stream=w58, BER trigger threshold=0.4) -> (BER=w59, trigger found?=w60)
  $BER <- w59
  $"trigger found?" <- w60
  $output <- w58
  Array Size(array=w58) -> (size(s)=w61)
  $"size(s)" <- w61
