vi "DPSK.gvi"   [LabVIEW Communications System Design Suite 2.0.1]
panel controls:
  "IQ rate": f64 = 200000
  "device names": "niUSRPClass"
  "carrier frequency": f64 = 400000000
  "gain Tx": f64
  "active antenna Tx": string = "TX1"
  "stop Tx": bool
  "gain Rx": f64
  "active antenna Rx": string = "RX2"
  "total bits": i32 = 128
  "symbol rate": f64
  "pulse shaping filter": T2 = "Root Raised Cos"
panel indicators:
  "Baseband Waveform": waveform<f64>
  "Baseband Power Spectrum_tx": T1
  "L": f64
  "1/Tx": f64
  "1/T": f64
  "No samples": i32
  "Baseband Power Spectrum_rx": T1
  "M": f64
  "output bits": i16[]
  "trigger found?": bool
  "BER": f64
  "message": i8[]
types:
  T1 = cluster{"f0": f64, "df": f64, "magnitude": f64[]}
  T2 = enum{"none", "Raised Cosine", "Root Raised Cos", "Gaussian"}
uses:
  NI::Analysis::Resampling::Upsample (DBL).gvi
  NI::Analysis::Operations::1D Convolution (DBL).gvi
  NI::Analysis::Operations::1D Convolution (CDB).gvi
  NI::Analysis::Resampling::Decimate (single shot, CDB).gvi
diagram:
  w1 = $"total bits"
  call "MT Generate Bits (Fibonacci, PN Order).gvi"(total bits=w1) -> (output bit stream=w2)
  $message <- w2
  Divide(x=$"IQ rate", y=$"symbol rate") -> w3
  for {
    w4 = each element of w2
    Is Greater Than 0(x=w4) -> w6
    Select(s=w6, t=w4, f=-1) -> w7
    append w7 to w5
  }
  call "AddFrameHeader.gvi"(array=w5) -> (output array=w8)
  s1 = 1  # shift register
  s2 = f64[] []  # shift register
  for {
    w9 = each element of w8
    Multiply(s1, w9) -> w10
    Build Array[ConcatenateInputs=True](s2, w10) -> w11
    next s1 = w10
    next s2 = w11
  }
  Build Array[ConcatenateInputs=True](1, s2) -> w12
  call "Upsample (DBL).gvi"(input array=w12, upsampling factor=w3) -> (upsampled array=w13)
  call "MT Generate Filter Coefficients.gvi"(pulse shaping filter=$"pulse shaping filter", pulse shaping samples per symbol=w3, modulation type="PSK") -> (pulse shaping filter coefficients=w14)
  call "1D Convolution (DBL).gvi"(x=w13, y=w14) -> (x * y=w15)
  call "Quick Scale 1D.gvi"(X=w15) -> (Y[i]=X[i]/Max|X|=w16)
  Build Waveform Node(Y=w16, dt=$"IQ rate") -> (output waveform=w17)
  $"Baseband Waveform" <- w17
  w18 = cluster{"t0": timestamp, "dt": f64, "Y": c128[]} {all zero or empty}
  Property Node(instance in=w18, "dt"=$"IQ rate", "Y"=w16) -> (instance out=w19)
  call "FFT Power Spectrum for 1 Chan (CDB)2.gvi"(time signal=w19, dB On (F)=TRUE) -> (power spectrum=w20)
  $"Baseband Power Spectrum_tx" <- w20
  $L <- w3
  $"1/Tx" <- $"IQ rate"
  $"1/T" <- $"symbol rate"
  call "niUSRP Open Rx Session.gvi"(device names=$"device names") -> (error out=w21, session handle out=w22)
  call "niUSRP Configure Signal.gvi"(session handle=w22, IQ rate=$"IQ rate", carrier frequency=$"carrier frequency", gain=$"gain Rx", error in=w21, active antenna=$"active antenna Rx") -> (session handle out=w23, coerced carrier frequency=w24, error out=w25)
  Subtract(x=w24, y=20000) -> w26
  Property Node(instance in=w23, "LO Frequency"=w26) -> (instance out=w27)
  call "niUSRP Initiate.gvi"(session handle=w27, error in=w25) -> (session handle out=w28, error out=w29)
  call "niUSRP Fetch Rx Data (CDB).gvi"(session handle=w28, number of samples=1000000, error in=w29) -> (session handle out=w30, data=w31, error out=w32)
  call "niUSRP Close Session.gvi"(session handle=w30, error in=w32)
  Array Size(array=w16) -> (size(s)=w33)
  $"No samples" <- w33
  call "niUSRP Open Tx Session.gvi"(device names=$"device names") -> (session handle out=w34, error out=w35)
  call "niUSRP Configure Signal.gvi"(session handle=w34, IQ rate=$"IQ rate", carrier frequency=$"carrier frequency", gain=$"gain Tx", error in=w35, active antenna=$"active antenna Tx") -> (session handle out=w36, error out=w37)
  while {
    call "niUSRP Write Tx Data (CDB).gvi"(session handle=w36, data=w16, error in=w37) -> (session handle out=w38, error out=w39)
    stop if $"stop Tx"
  }
  call "niUSRP Close Session.gvi"(session handle=w38, error in=w39)
  $M <- w3
  call "MT Generate Filter Coefficients.gvi"(pulse shaping filter="Root Raised Cos", matched samples per symbol=w3, modulation type="PSK") -> (matched filter coefficients=w40)
  call "1D Convolution (CDB).gvi"(x=w40, y=w31) -> (x * y=w41)
  w42 = cluster{"t0": timestamp, "dt": f64, "Y": c128[]} {all zero or empty}
  Property Node(instance in=w42, "dt"=$"IQ rate", "Y"=w41) -> (instance out=w43)
  call "FFT Power Spectrum for 1 Chan (CDB)2.gvi"(time signal=w43, dB On (F)=TRUE) -> (power spectrum=w44)
  $"Baseband Power Spectrum_rx" <- w44
  call "PulseAlign.gvi"(Input signal=w41, Receiver Sampling Factor=w3) -> (aligned output=w45)
  call "Decimate (single shot, CDB).gvi"(input array=w45, decimating factor=w3) -> (decimated array=w46)
  for (N = w1) (iteration -> i1) {
    w47 = each element of w46
    Increment(x=i1) -> w49
    Array Index(array=w46) -> (out0[w49]=w50)
    Complex Conjugate(x + iy=w50) -> w51
    Multiply(w47, w51) -> w52
    Complex To Real Imaginary(x + iy=w52) -> (x=w53)
    append w53 to w48
  }
  call "FrameSync.gvi"(Sampled Input=w48) -> (Aligned Samples=w54)
  for {
    w55 = each element of w54
    Complex To Real Imaginary(x + iy=w55) -> (x=w57)
    Is Greater Than 0(x=w57) -> w58
    append w58 to w56
  }
  Boolean To Integer(Boolean=w56) -> (0, 1=w59)
  Array Subset(array=w59, index0=0, length0=w1) -> w60
  call "MT Calculate BER After Trigger (Fibonacci PN Sequence).gvi"(input bit stream=w60, BER trigger threshold=0.4) -> (BER=w61, trigger found?=w62)
  $BER <- w61
  $"trigger found?" <- w62
  $"output bits" <- w60
